# Grasshopper definition Honeybee-GrizzlyBear beta - minimal implementation.gh (Grasshopper 0.9.75)
# plug-ins: Python Interpreter, HDTReference

# ---- group: doItAll
# Set To True To Solve
number_slider = Slider(1, range=1..10)
cir = Circle(Plane=PlaneXY(0, 0, 0), Radius=number_slider)
Z = UnitZ(Factor=Slider(1, range=1..10))
runitall = CSharpScript(folder="c:\images", makeimages=Toggle(False))  # -> out, A; inputs mySliders: list, folder: String, makeimages: Boolean
# ---------- runitall: C# ----------
    if (!makeimages)
      return;

    if (_running)
      return;

    if (!System.IO.Directory.Exists(folder))
      System.IO.Directory.CreateDirectory(folder);

    _folder = folder;
    _run = true;
    _mySliders = mySliders;

    GrasshopperDocument.SolutionEnd += OnSolutionEnd;
# ---------- runitall: C# additional code ----------
  private bool _run = false;
  private bool _running = false;
  private string _folder;
  private List<System.Object> _mySliders;

  public void OnSolutionEnd(object sender, GH_SolutionEventArgs e)
  {
    // Unregister the event, we don't want to get called again.
    e.Document.SolutionEnd -= OnSolutionEnd;

    // If we're not supposed to run, abort now.
    if (!_run)
      return;

    // If we're already running, abort now.
    if (_running)
      return;

    // Reset run and running states.
    _run = false;
    _running = true;

    try
    {
      // Find the Guid for connected slides
      List<System.Guid> guids = new List<System.Guid>();
      Grasshopper.Kernel.IGH_Param selSlidersInput = Component.Params.Input[0];
      IList<Grasshopper.Kernel.IGH_Param> sources = selSlidersInput.Sources;
      bool isMySlidersEmpty = !sources.Any();

      if (!isMySlidersEmpty) {
        foreach (var source in sources)
        {
          IGH_DocumentObject component = source.Attributes.GetTopLevel.DocObject;
          Grasshopper.Kernel.Special.GH_NumberSlider mySlider = component as Grasshopper.Kernel.Special.GH_NumberSlider;
          if (mySlider == null)
            continue;
          guids.Add(mySlider.InstanceGuid);
        }
      }

      // Find all sliders.
      List<Grasshopper.Kernel.Special.GH_NumberSlider> sliders = new List<Grasshopper.Kernel.Special.GH_NumberSlider>();
      foreach (IGH_DocumentObject docObject in GrasshopperDocument.Objects)
      {
        Grasshopper.Kernel.Special.GH_NumberSlider slider = docObject as Grasshopper.Kernel.Special.GH_NumberSlider;
        if (slider != null)
        {
          // check if the slider is in the selected list
          if (!isMySlidersEmpty)
          {
            if (guids.Contains(slider.InstanceGuid)) sliders.Add(slider);
          }
          else
          {
            sliders.Add(slider);
          }
        }
      }
      if (sliders.Count == 0)
      {
        System.Windows.Forms.MessageBox.Show("No sliders could be found", "<harsh buzzing sound>", MessageBoxButtons.OK);
        return;
      }

      // Set all sliders back to zero.
      //GH_Document.EnableSolutions = false;
      foreach (Grasshopper.Kernel.Special.GH_NumberSlider slider in sliders)
        slider.TickValue = 0;

      // Start a giant loop in which we'll permutate our way across all slider layouts.
      int imageNumber = 0;
      int A = imageNumber;
      while (true)
      {
        int idx = 0;
        if (!MoveToNextPermutation(ref idx, sliders))
          break;

        // We've just got a new valid permutation. Solve the new solution.
        e.Document.NewSolution(false);
        Rhino.RhinoDoc.ActiveDoc.Views.Redraw();

        Rhino.Display.RhinoView view = RhinoDocument.Views.Find("Perspective", false);
        if (view == null)
          break;

        string fileName = string.Format("{0}\\{1}.png", _folder, imageNumber);
        imageNumber++;

        Bitmap image = view.CaptureToBitmap();
        if (image == null)
          continue;

        image.Save(fileName);
        image.Dispose();
        image = null;
      }
    }
    catch(Exception ex)
    {
      // Ehm, exception, best swallow it here lest it totally crashes everything.
    }
    finally
    {
      // Always make sure that _running is switched off.
      _running = false;
    }
  }

  private bool MoveToNextPermutation(ref int index, List<Grasshopper.Kernel.Special.GH_NumberSlider> sliders)
  {
    if (index >= sliders.Count)
      return false;

    Grasshopper.Kernel.Special.GH_NumberSlider slider = sliders[index];
    if (slider.TickValue < slider.TickCount)
    {
      // Increment the slider.
      slider.TickValue++;
      return true;
    }
    else
    {
      // The current slider is already at the maximum value. Reset it back to zero.
      slider.TickValue = 0;

      // Move on to the next slider.
      index++;

      // If we've run out of sliders to modify, we're done permutatin'
      if (index >= sliders.Count)
        return false;

      return MoveToNextPermutation(ref index, sliders);
    }
  }
# ---------- end runitall ----------
extr = Extrude(Base=cir, Direction=Z)

# ----
toggle = BooleanToggle(True)
panel = Panel("10,0,0")
floors = Brep([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])
Z_2 = UnitZ(Factor=Slider(3.4, range=3..4.2))
box = DomainBox(Base=PlaneXY(0, 0, 0), X=Slider(24, range=0..30), Y=Slider(65, range=0..100), Z=Slider(12, range=0..24))
extr_2 = Extrude(Base=floors, Direction=Z_2)
ladybug = Ladybug_Ladybug()  # -> Vviiiiiiiiiizzz; plug-in component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
honeybee = Honeybee_Honeybee()  # -> Vviiiiiiiiiizzz; plug-in component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
panel_2 = Panel("C:\Users\MSadeghipourRoudsari\Dropbox\ladybug\honeybee_github")
toggle_2 = BooleanToggle(True)
panel_3 = Panel("@4")
panel_5 = Panel(ladybug)
intersectmass = Honeybee_IntersectMasses(bldgMassesBefore=flatten(box))  # -> bldgMassesAfter; plug-in component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
toggle_3 = BooleanToggle(False)
panel_6 = Panel(intersectmass)
updatehoneybee = Honeybee_UpdateHoneybee(updateAllUObjects=toggle_3)  # -> readMe; plug-in component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
exportladybug = Ladybug_ExportLadybug(targetFolder="C:\Users\Administrator\Dropbox\ladybug\honeybee_github", export=toggle_3)  # -> readMe; plug-in component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
panel_7 = Panel(updatehoneybee)

# ---- group: This component should be modified to adopt the new method for now I just leave it as it is
mass2zone = Honeybee_Masses2Zones(bldgMasses=flatten(intersectmass), maximumRoofAngle=30, createHoneybeeZones=Toggle(True))  # -> readMe, HBZones; plug-in component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

# ----
panel_8 = Panel(mass2zone.readMe)
panel_9 = Panel("Adiabatic")
solveadjc = Honeybee_SolveAdjacencies(HBZones=flatten(mass2zone.HBZones), findAdjc=Toggle(True))  # -> readMe, HBZonesWADJ; plug-in component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
panel_10 = Panel(solveadjc.readMe)
bldgprograms = Honeybee_bldgPrograms({"Office": 0, "Retail": 1, "MidriseApartment": 2, "PrimarySchool": 3, "SecondarySchool": 4, "SmallHotel": 5, "LargeHotel": 6, "Hospital": 7, "Outpatient": 8, "Warehouse": 9, "SuperMarket": 10, "FullServiceRestaurant": 11, "QuickServiceRestaurant": 12}, selected="Office")
item = ListItem(List=mass2zone.HBZones, Index=Slider(17, range=0..50), Wrap=True)
preview = CustomPreview(
    Geometry=item,
    Shader={ambient=RGB(0, 0, 0), diffuse=RGB(255, 105, 180), emission=RGB(76, 32, 54), shine=0.5, specular=RGB(255, 255, 255), transparency=0})
listzoneprograms = Honeybee_ListZonePrograms(bldgProgram=bldgprograms)  # -> bldgProgram, OfficeSubPrograms; plug-in component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
list = ItemSelector(
    listzoneprograms.OfficeSubPrograms,
    {"BreakRoom", "Storage", "Vending", "OpenOffice", "ClosedOffice", "Conference", "PrintRoom", "Restroom", "Elec/MechRoom", "IT_Room", "Stair", "Corridor", "Lobby"}, selected="OpenOffice")

# ---- group: add windows
glazingcreator = Honeybee_GlazingBasedOnRatio(HBObjects=flatten(solveadjc.HBZonesWADJ), glzRatio=flatten(Slider(0.4, range=0..1)), runIt=Toggle(True))  # -> readMe, HBObjWGLZ; plug-in component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

# ----
list_2 = ItemSelector(
    listzoneprograms.OfficeSubPrograms,
    {"BreakRoom", "Storage", "Vending", "OpenOffice", "ClosedOffice", "Conference", "PrintRoom", "Restroom", "Elec/MechRoom", "IT_Room", "Stair", "Corridor", "Lobby"}, selected="BreakRoom")
list_3 = ItemSelector(
    listzoneprograms.OfficeSubPrograms,
    {"BreakRoom", "Storage", "Vending", "OpenOffice", "ClosedOffice", "Conference", "PrintRoom", "Restroom", "Elec/MechRoom", "IT_Room", "Stair", "Corridor", "Lobby"}, selected="Storage")
list_4 = ItemSelector(
    listzoneprograms.OfficeSubPrograms,
    {"BreakRoom", "Storage", "Vending", "OpenOffice", "ClosedOffice", "Conference", "PrintRoom", "Restroom", "Elec/MechRoom", "IT_Room", "Stair", "Corridor", "Lobby"}, selected="Conference")
toggle_4 = BooleanToggle(False)
panel_11 = Panel(glazingcreator.readMe)
# This zones are actually
# ready for simulation.
# Customization is optional.
# Default is Office, OpenOffice.
wires = BrepWireframe(Brep=glazingcreator.HBObjWGLZ, Density=-1)

# ---- group: make roofs and floors adiabatic
makeadiabaticbytype = Honeybee_MakeAdiabaticByType(HBZones=glazingcreator.HBObjWGLZ, walls=toggle_4, floors=toggle_4, ceilings=toggle_4)  # -> HBZones; plug-in component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

# ----
graft = GraftTree(Tree=makeadiabaticbytype, IncludeEmptyLists=True, IncludeNullItems=True)  # -> simplify(Tree)

# ---- group: This component assign it all at once
setloadsandschedules = Honeybee_SetLoadsAndSchedules(HBZones=graft, bldgProgram=listzoneprograms.bldgProgram, zoneProgram=list)  # -> currentSchedules, currentLoads, HBZones; plug-in component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

# ----
callfromepschlibrary = Honeybee_CallFromEPScheduleLibrary()  # -> scheduleTypeLimits, scheduleList; plug-in component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
panel_12 = Panel(callfromepschlibrary.scheduleList)
item_2 = ListItem(List=makeadiabaticbytype, Index=Slider(11, range=0..20), Wrap=True)
preview_2 = CustomPreview(
    Geometry=item_2,
    Shader={ambient=RGB(0, 0, 0), diffuse=RGB(255, 105, 180), emission=RGB(76, 32, 54), shine=0.5, specular=RGB(255, 255, 255), transparency=0})

# ---- group: This one lets you to overwrite the schedules
setepzoneschedules = Honeybee_SetEnergyPlusZoneSchedules(HBZones=setloadsandschedules.HBZones)  # -> schedules, HBZones; plug-in component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

# ----
panel_13 = Panel("""wall
window
roof
floor""")
panel_14 = Panel(setloadsandschedules.currentLoads)
callfromepconstrlibrary = Honeybee_CallFromEPConstructionLibrary()  # -> EPMaterials, EPWindowMaterils, EPConstructios; plug-in component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
panel_15 = Panel(setloadsandschedules.currentSchedules)
graft_2 = GraftTree(Tree=panel_13, IncludeEmptyLists=True, IncludeNullItems=True)
panel_16 = Panel(setepzoneschedules.schedules)

# ---- group: This one lets you modify the loads
setepzoneloads = Honeybee_SetEnergyPlusZoneLoads(HBZones=setloadsandschedules.HBZones)  # -> loads, HBZones; plug-in component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

# ----
searchepconstruction = Honeybee_SearchEPConstruction(
    EPConstrList=callfromepconstrlibrary.EPConstructios,
    standard=Slider(0, range=0..10),
    climateZone="1A",
    surfaceType=graft_2,
    constructionType="Metal")  # -> EPSelectedConstr; plug-in component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
panel_17 = Panel(setepzoneloads.loads)
item_3 = ListItem(List=searchepconstruction, Index=0, Wrap=True)  # -> simplify(Item)
panel_18 = Panel(item_3)
number_slider_2 = Slider(18, range=0..100)
bang = ExplodeTree(Data=item_3)  # -> Branch0, Branch1, Branch2, Branch3
simcontrol = Honeybee_SimulationControl()  # -> simControls; plug-in component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
shadowpar = Honeybee_ShadowPar()  # -> shadowPar; plug-in component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
setepzonecnstr = Honeybee_SetEPZoneConstruction(
    HBZone=setloadsandschedules.HBZones,
    wallEPConstruction=bang.Branch0,
    windowEPConstruction=bang.Branch1,
    roofEPConstruction=bang.Branch2,
    floorEPConstruction=bang.Branch3)  # -> simplify(modifiedHBZone); plug-in component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

# ---- group: Set Thresholds
setepzonethresholds = Honeybee_SetEnergyPlusZoneThresholds(
    HBZones=setloadsandschedules.HBZones,
    daylightThreshold=Slider(200, range=0..1000),
    coolingSetPt=Slider(22, range=0..100))  # -> HBZones; plug-in component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

# ----
panel_19 = Panel(simcontrol)
panel_20 = Panel(shadowpar)
energysimpar = Honeybee_EnergySimulationPar(timestep=6, solarDistribution=Slider(1, range=0..5))  # -> energySimPar; plug-in component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

# ---- group: and finally constructions - interior walls
setepzoneintcnstr = Honeybee_SetEPZoneInteriorConstruction()  # -> simplify(modifiedHBZone); plug-in component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

# ----
panel_21 = Panel(setepzonethresholds)
panel_22 = Panel(energysimpar)
openstudiohvacsystemslist = Honeybee_OpenStudioHVACSystemsList({"0. Ideal Air Loads": 0, "1. PTAC | Residential": 1, "2. PTHP | Residential": 2, "3. PSZ-AC": 3, "4. PSZ-HP": 4, "5. Packaged VAV w/ Reheat": 5, "6. Packaged VAV w/ PFP Boxes": 6, "7. VAV w/ Reheat": 7, "8. VAV w/ PFP Boxes": 8, "9. Warm Air Furnace - Gas Fired": 9, "10.Warm Air Furnace - Electric": 10}, selected="7. VAV w/ Reheat")
brep = Brep()
oshvacsystems = Honeybee_OpenStudioSystems(HBZones=flatten(setepzonethresholds), HVACSystems=openstudiohvacsystemslist)  # -> HBZones; plug-in component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
hb_epcontextsrf = HoneybeeEPContextSurfaces(shdSurfaces=flatten(brep))  # -> readMe, HBContext; inputs shdSurfaces: list of GeometryBase, EPtransSchedule: list
# ---------- hb_epcontextsrf: Python ----------
"""
prepare shading/context geometries

    Args:
        northVectorOrRotation: A vector that shows North or a number that shows
                               the rotation of the North from the Y axis
        bldgMasses: List of closed Breps as thermal zones.
    Returns:
        report: ...
        thermalZones: Thermal zone's geometries for visualiza
"""

ghenv.Component.Name = 'Honeybee EP context Surfaces'
ghenv.Component.NickName = 'HB_EPContextSrf'
ghenv.Component.Message = 'VER 0.0.53\nMAY_12_2014'
ghenv.Component.Category = "Honeybee"
ghenv.Component.SubCategory = "09 | Energy | Energy"
ghenv.Component.AdditionalHelpFromDocStrings = "1"

import rhinoscriptsyntax as rs
import Rhino as rc
import scriptcontext as sc
import os
import System
from clr import AddReference
AddReference('Grasshopper')
import Grasshopper.Kernel as gh

tolerance = sc.doc.ModelAbsoluteTolerance
import math


def main():
    # import the classes
    if sc.sticky.has_key('ladybug_release')and sc.sticky.has_key('honeybee_release'):
        
        # don't customize this part
        hb_EPSrf = sc.sticky["honeybee_EPSurface"]
        hb_EPSHDSurface = sc.sticky["honeybee_EPShdSurface"]

        ########################################################################
        #----------------------------------------------------------------------#
        shdBreps = []
        if justBoundingBox:
            for brep in shdSurfaces:
                if brep.Faces.Count>1 or not brep.Faces[0].IsPlanar(sc.doc.ModelAbsoluteTolerance):
                    shdBreps.append(brep.GetBoundingBox(True).ToBrep())
                else:
                    shdBreps.append(brep)
        else: shdBreps = shdSurfaces
        
        shadingClasses = []
        shadingMeshPreview = []
        if meshingLevel == 0:
            mp = rc.Geometry.MeshingParameters.Minimal
            mp.SimplePlanes = True
        elif 0.25 < meshingLevel <0.75:
            mp = rc.Geometry.MeshingParameters.Default
        else:
            mp = rc.Geometry.MeshingParameters.Smooth
        
        def getRadMaterialName(radMaterial):
            nameStr = radMaterial.split(" ")[2]
            name =  nameStr.split("\n")[0]
            return name
        
        for brepCount, brep in enumerate(shdBreps):
            if len(brep.DuplicateEdgeCurves(False))>1:
                meshedGeo = rc.Geometry.Mesh.CreateFromBrep(brep, mp)
                for brepFaceIndex in range(brep.Faces.Count):
                    mesh = meshedGeo[brepFaceIndex]
                    #for meshCount, mesh in enumerate(meshedGeo):
                    thisShading = hb_EPSHDSurface(brep.Faces[brepFaceIndex].ToBrep(), 1000*brepCount + brepFaceIndex, 'shdSrf_' + `brepCount` + '_' + `brepFaceIndex`)
                    for faceIndex in  range(mesh.Faces.Count):
                        thisShading.collectMeshFaces(mesh.Faces.GetFaceVertices(faceIndex))
                    if EPConstruction!=None: thisShading.EPConstruction = EPConstruction
                    if RADConstruction!=None: thisShading.RadMaterial = getRadMaterialName(RADConstruction)
                    shadingClasses.append(thisShading)
                    # shadingMeshPreview.append(thisShading.meshedFace)
                    brepFaceIndex += 1
        
        # add to the hive
        hb_hive = sc.sticky["honeybee_Hive"]()
        HBContext  = hb_hive.addToHoneybeeHive(shadingClasses, ghenv.Component.InstanceGuid.ToString())
        return HBContext
        ################################################################################################
    else:
        print "You should first let both Ladybug and Honeybee to fly..."
        w = gh.GH_RuntimeMessageLevel.Warning
        ghenv.Component.AddRuntimeMessage(w, "You should first let both Ladybug and Honeybee to fly...")
        return -1
        

if shdSurfaces and shdSurfaces[0]!=None:
    # add cleaning function
    result= main()
    
    if result != -1: HBContext = result
# ---------- end hb_epcontextsrf ----------
writeresultparameters = Honeybee_WriteEPResultParameters(
    zoneEnergyUse="True",
    zoneGainsAndLosses="False",
    zoneTemperatures=Toggle(True),
    surfaceAnalysis="False",
    timestep="hourly")  # -> report, simulationOutputs; plug-in component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
analysisperiod = Ladybug_AnalysisPeriod(fromMonth=Slider(1, range=0..1))  # -> readMe, analysisPeriod; plug-in component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
panel_23 = Panel("""Output:Meter,Electricity:HVAC,hourly; !- [J]
Output:Meter,Fans:Electricity,hourly; !- [J]
Output:Meter,CoolingCoils:EnergyTransfer,hourly; !- [J]
Output:Meter,Cooling:Electricity,hourly; !- [J]
Output:Meter,Heating:Gas,hourly; !- [J]
Output:Meter,Pumps:Electricity,hourly; !- [J]
Output:Meter,InteriorLights:Electricity:Zone:0_0,hourly; !- [J]
Output:Meter,InteriorEquipment:Electricity,hourly; !- [J]
Output:Variable,*,Zone Air Terminal VAV Damper Position,hourly; !- HVAC Average []
Output:Variable,*,Fan Electric Energy,hourly; !- HVAC Sum [J]
Output:Variable,*,Boiler Inlet Temperature,hourly; !- HVAC Average [C]
Output:Variable,*,Boiler Outlet Temperature,hourly; !- HVAC Average [C]
Output:Variable,*,Boiler Mass Flow Rate,hourly; !- HVAC Average [kg/s]
Output:Variable,*,Air System Total Heating Energy,hourly; !- HVAC Sum [J]
Output:Variable,*,Air System Total Cooling Energy,hourly; !- HVAC Sum [J]""")
panel_24 = Panel(writeresultparameters.simulationOutputs)
path = FilePath("C:\EnergyPlusV7-2-0\WeatherData\USA_CA_San.Francisco.Intl.AP.724940_TMY3.epw")

bldgtype = ValueList({"Office", "School", "Hospital", "Lab"}, selected="Office")
epd = ValueList({"Low", "Med", "High"}, selected="Low")
lpd = ValueList({"Low", "Med", "High"}, selected="Low")

# ----
# OpenStudio
exporttoopenstudio = Honeybee_ExportToOpenStudio(
    north=Slider(0, range=0..100),
    epwWeatherFile=path,
    analysisPeriod=analysisperiod.analysisPeriod,
    energySimPar=energysimpar,
    HBZones=flatten(oshvacsystems),
    simulationOutputs=panel_23,
    writeOSM=Toggle(True),
    runSimulation=Toggle(False),
    fileName="test4")  # -> ReadMe, osmFileAddress, idfFileAddress, resultsFileAddress; plug-in component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
panel_25 = Panel("""! Program Version,EnergyPlus-Windows-64 8.1.0.009, YMD=2014.05.17 17:28,IDD_Version 8.1.0.009
! Output:Variable Objects (applicable to this run)
Output:Variable,*,Site Outdoor Air Drybulb Temperature,hourly; !- Zone Average [C]
Output:Variable,*,Site Outdoor Air Dewpoint Temperature,hourly; !- Zone Average [C]
Output:Variable,*,Site Outdoor Air Wetbulb Temperature,hourly; !- Zone Average [C]
Output:Variable,*,Site Outdoor Air Humidity Ratio,hourly; !- Zone Average [kgWater/kgDryAir]
Output:Variable,*,Site Outdoor Air Relative Humidity,hourly; !- Zone Average [%]
Output:Variable,*,Site Outdoor Air Barometric Pressure,hourly; !- Zone Average [Pa]
Output:Variable,*,Site Wind Speed,hourly; !- Zone Average [m/s]
Output:Variable,*,Site Wind Direction,hourly; !- Zone Average [deg]
Output:Variable,*,Site Sky Temperature,hourly; !- Zone Average [C]
Output:Variable,*,Site Horizontal Infrared Radiation Rate per Area,hourly; !- Zone Average [W/m2]
Output:Variable,*,Site Diffuse Solar Radiation Rate per Area,hourly; !- Zone Average [W/m2]
Output:Variable,*,Site Direct Solar Radiation Rate per Area,hourly; !- Zone Average [W/m2]
Output:Variable,*,Site Precipitation Depth,hourly; !- Zone Sum [m]
Output:Variable,*,Site Ground Reflected Solar Radiation Rate per Area,hourly; !- Zone Average [W/m2]
Output:Variable,*,Site Ground Temperature,hourly; !- Zone Average [C]
Output:Variable,*,Site Surface Ground Temperature,hourly; !- Zone Average [C]
Output:Variable,*,Site Deep Ground Temperature,hourly; !- Zone Average [C]
Output:Variable,*,Site Simple Factor Model Ground Temperature,hourly; !- Zone Average [C]
Output:Variable,*,Site Outdoor Air Enthalpy,hourly; !- Zone Average [J/kg]
Output:Variable,*,Site Outdoor Air Density,hourly; !- Zone Average [kg/m3]
Output:Variable,*,Site Solar Azimuth Angle,hourly; !- Zone Average [deg]
Output:Variable,*,Site Solar Altitude Angle,hourly; !- Zone Average [deg]
Output:Variable,*,Site Solar Hour Angle,hourly; !- Zone Average [deg]
Output:Variable,*,Site Rain Status,hourly; !- Zone Average []
Output:Variable,*,Site Snow on Ground Status,hourly; !- Zone Average []
Output:Variable,*,Site Exterior Horizontal Sky Illuminance,hourly; !- Zone Average [lux]
Output:Variable,*,Site Exterior Horizontal Beam Illuminance,hourly; !- Zone Average [lux]
Output:Variable,*,Site Exterior Beam Normal Illuminance,hourly; !- Zone Average [lux]
Output:Variable,*,Site Sky Diffuse Solar Radiation Luminous Efficacy,hourly; !- Zone Average [lum/W]
Output:Variable,*,Site Beam Solar Radiation Luminous Efficacy,hourly; !- Zone Average [lum/W]
Output:Variable,*,Site Daylighting Model Sky Clearness,hourly; !- Zone Average []
Output:Variable,*,Site Daylighting Model Sky Brightness,hourly; !- Zone Average []
Output:Variable,*,Site Daylight Saving Time Status,hourly; !- Zone Average []
Output:Variable,*,Site Day Type Index,hourly; !- Zone Average []
Output:Variable,*,Site Mains Water Temperature,hourly; !- Zone Average [C]
Output:Variable,*,Zone Outdoor Air Drybulb Temperature,hourly; !- Zone Average [C]
Output:Variable,*,Zone Outdoor Air Wetbulb Temperature,hourly; !- Zone Average [C]
Output:Variable,*,Zone Outdoor Air Wind Speed,hourly; !- Zone Average [m/s]
Output:Variable,*,Zone Total Internal Radiant Heating Energy,hourly; !- Zone Sum [J]
Output:Variable,*,Zone Total Internal Radiant Heating Rate,hourly; !- Zone Average [W]
Output:Variable,*,Zone Total Internal Visible Radiation Heating Energy,hourly; !- Zone Sum [J]
Output:Variable,*,Zone Total Internal Visible Radiation Heating Rate,hourly; !- Zone Average [W]
Output:Variable,*,Zone Total Internal Convective Heating Energy,hourly; !- Zone Sum [J]
Output:Variable,*,Zone Total Internal Convective Heating Rate,hourly; !- Zone Average [W]
Output:Variable,*,Zone Total Internal Latent Gain Energy,hourly; !- Zone Sum [J]
Output:Variable,*,Zone Total Internal Latent Gain Rate,hourly; !- Zone Average [W]
Output:Variable,*,Zone Total Internal Total Heating Energy,hourly; !- Zone Sum [J]
Output:Variable,*,Zone Total Internal Total Heating Rate,hourly; !- Zone Average [W]
Output:Variable,*,People Occupant Count,hourly; !- Zone Average []
Output:Variable,*,People Radiant Heating Energy,hourly; !- Zone Sum [J]
Output:Variable,*,People Radiant Heating Rate,hourly; !- Zone Average [W]
Output:Variable,*,People Convective Heating Energy,hourly; !- Zone Sum [J]
Output:Variable,*,People Convective Heating Rate,hourly; !- Zone Average [W]
Output:Variable,*,People Sensible Heating Energy,hourly; !- Zone Sum [J]
Output:Variable,*,People Sensible Heating Rate,hourly; !- Zone Average [W]
Output:Variable,*,People Latent Gain Energy,hourly; !- Zone Sum [J]
Output:Variable,*,People Latent Gain Rate,hourly; !- Zone Average [W]
Output:Variable,*,People Total Heating Energy,hourly; !- Zone Sum [J]
Output:Variable,*,People Total Heating Rate,hourly; !- Zone Average [W]
Output:Variable,*,People Air Temperature,hourly; !- Zone Average [C]
Output:Variable,*,People Air Relative Humidity,hourly; !- Zone Average [%]
Output:Variable,*,Zone People Occupant Count,hourly; !- Zone Average []
Output:Variable,*,Zone People Radiant Heating Energy,hourly; !- Zone Sum [J]
Output:Variable,*,Zone People Radiant Heating Rate,hourly; !- Zone Average [W]
Output:Variable,*,Zone People Convective Heating Energy,hourly; !- Zone Sum [J]
Output:Variable,*,Zone People Convective Heating Rate,hourly; !- Zone Average [W]
Output:Variable,*,Zone People Sensible Heating Energy,hourly; !- Zone Sum [J]
Output:Variable,*,Zone People Sensible Heating Rate,hourly; !- Zone Average [W]
Output:Variable,*,Zone People Latent Gain Energy,hourly; !- Zone Sum [J]
Output:Variable,*,Zone People Latent Gain Rate,hourly; !- Zone Average [W]
Output:Variable,*,Zone People Total Heating Energy,hourly; !- Zone Sum [J]
Output:Variable,*,Zone People Total Heating Rate,hourly; !- Zone Average [W]
Output:Variable,*,Lights Electric Power,hourly; !- Zone Average [W]
Output:Variable,*,Lights Radiant Heating Energy,hourly; !- Zone Sum [J]
Output:Variable,*,Lights Radiant Heating Rate,hourly; !- Zone Average [W]
Output:Variable,*,Lights Visible Radiation Heating Energy,hourly; !- Zone Sum [J]
Output:Variable,*,Lights Visible Radiation Heating Rate,hourly; !- Zone Average [W]
Output:Variable,*,Lights Convective Heating Energy,hourly; !- Zone Sum [J]
Output:Variable,*,Lights Convective Heating Rate,hourly; !- Zone Average [W]
Output:Variable,*,Lights Return Air Heating Energy,hourly; !- Zone Sum [J]
Output:Variable,*,Lights Return Air Heating Rate,hourly; !- Zone Average [W]
Output:Variable,*,Lights Total Heating Energy,hourly; !- Zone Sum [J]
Output:Variable,*,Lights Total Heating Rate,hourly; !- Zone Average [W]
Output:Variable,*,Lights Electric Energy,hourly; !- Zone Sum [J]
Output:Variable,*,Zone Lights Electric Power,hourly; !- Zone Average [W]
Output:Variable,*,Zone Lights Electric Energy,hourly; !- Zone Sum [J]
Output:Variable,*,Zone Lights Radiant Heating Energy,hourly; !- Zone Sum [J]
Output:Variable,*,Zone Lights Radiant Heating Rate,hourly; !- Zone Average [W]
Output:Variable,*,Zone Lights Visible Radiation Heating Energy,hourly; !- Zone Sum [J]
Output:Variable,*,Zone Lights Visible Radiation Heating Rate,hourly; !- Zone Average [W]
Output:Variable,*,Zone Lights Convective Heating Energy,hourly; !- Zone Sum [J]
Output:Variable,*,Zone Lights Convective Heating Rate,hourly; !- Zone Average [W]
Output:Variable,*,Zone Lights Return Air Heating Energy,hourly; !- Zone Sum [J]
Output:Variable,*,Zone Lights Return Air Heating Rate,hourly; !- Zone Average [W]
Output:Variable,*,Zone Lights Total Heating Energy,hourly; !- Zone Sum [J]
Output:Variable,*,Zone Lights Total Heating Rate,hourly; !- Zone Average [W]
Output:Variable,*,Electric Equipment Electric Power,hourly; !- Zone Average [W]
Output:Variable,*,Electric Equipment Electric Energy,hourly; !- Zone Sum [J]
Output:Variable,*,Electric Equipment Radiant Heating Energy,hourly; !- Zone Sum [J]
Output:Variable,*,Electric Equipment Radiant Heating Rate,hourly; !- Zone Average [W]
Output:Variable,*,Electric Equipment Convective Heating Energy,hourly; !- Zone Sum [J]
Output:Variable,*,Electric Equipment Convective Heating Rate,hourly; !- Zone Average [W]
Output:Variable,*,Electric Equipment Latent Gain Energy,hourly; !- Zone Sum [J]
Output:Variable,*,Electric Equipment Latent Gain Rate,hourly; !- Zone Average [W]
Output:Variable,*,Electric Equipment Lost Heat Energy,hourly; !- Zone Sum [J]
Output:Variable,*,Electric Equipment Lost Heat Rate,hourly; !- Zone Average [W]
Output:Variable,*,Electric Equipment Total Heating Energy,hourly; !- Zone Sum [J]
Output:Variable,*,Electric Equipment Total Heating Rate,hourly; !- Zone Average [W]
Output:Variable,*,Zone Electric Equipment Electric Power,hourly; !- Zone Average [W]
Output:Variable,*,Zone Electric Equipment Electric Energy,hourly; !- Zone Sum [J]
Output:Variable,*,Zone Electric Equipment Radiant Heating Energy,hourly; !- Zone Sum [J]
Output:Variable,*,Zone Electric Equipment Radiant Heating Rate,hourly; !- Zone Average [W]
Output:Variable,*,Zone Electric Equipment Convective Heating Energy,hourly; !- Zone Sum [J]
Output:Variable,*,Zone Electric Equipment Convective Heating Rate,hourly; !- Zone Average [W]
Output:Variable,*,Zone Electric Equipment Latent Gain Energy,hourly; !- Zone Sum [J]
Output:Variable,*,Zone Electric Equipment Latent Gain Rate,hourly; !- Zone Average [W]
Output:Variable,*,Zone Electric Equipment Lost Heat Energy,hourly; !- Zone Sum [J]
Output:Variable,*,Zone Electric Equipment Lost Heat Rate,hourly; !- Zone Average [W]
Output:Variable,*,Zone Electric Equipment Total Heating Energy,hourly; !- Zone Sum [J]
Output:Variable,*,Zone Electric Equipment Total Heating Rate,hourly; !- Zone Average [W]
Output:Variable,*,Zone Windows Total Transmitted Solar Radiation Rate,hourly; !- Zone Average [W]
Output:Variable,*,Zone Exterior Windows Total Transmitted Beam Solar Radiation Rate,hourly; !- Zone Average [W]
Output:Variable,*,Zone Interior Windows Total Transmitted Beam Solar Radiation Rate,hourly; !- Zone Average [W]
Output:Variable,*,Zone Exterior Windows Total Transmitted Diffuse Solar Radiation Rate,hourly; !- Zone Average [W]
Output:Variable,*,Zone Interior Windows Total Transmitted Diffuse Solar Radiation Rate,hourly; !- Zone Average [W]
Output:Variable,*,Zone Windows Total Heat Gain Rate,hourly; !- Zone Average [W]
Output:Variable,*,Zone Windows Total Heat Loss Rate,hourly; !- Zone Average [W]
Output:Variable,*,Zone Windows Total Transmitted Solar Radiation Energy,hourly; !- Zone Sum [J]
Output:Variable,*,Zone Exterior Windows Total Transmitted Beam Solar Radiation Energy,hourly; !- Zone Sum [J]
Output:Variable,*,Zone Interior Windows Total Transmitted Beam Solar Radiation Energy,hourly; !- Zone Sum [J]
Output:Variable,*,Zone Exterior Windows Total Transmitted Diffuse Solar Radiation Energy,hourly; !- Zone Sum [J]
Output:Variable,*,Zone Interior Windows Total Transmitted Diffuse Solar Radiation Energy,hourly; !- Zone Sum [J]
Output:Variable,*,Zone Windows Total Heat Gain Energy,hourly; !- Zone Sum [J]
Output:Variable,*,Zone Windows Total Heat Loss Energy,hourly; !- Zone Sum [J]
Output:Variable,*,Surface Outside Face Sunlit Area,hourly; !- Zone Average [m2]
Output:Variable,*,Surface Outside Face Sunlit Fraction,hourly; !- Zone Average []
Output:Variable,*,Surface Outside Face Incident Solar Radiation Rate per Area,hourly; !- Zone Average [W/m2]
Output:Variable,*,Surface Outside Face Incident Beam Solar Radiation Rate per Area,hourly; !- Zone Average [W/m2]
Output:Variable,*,Surface Outside Face Incident Sky Diffuse Solar Radiation Rate per Area,hourly; !- Zone Average [W/m2]
Output:Variable,*,Surface Outside Face Incident Ground Diffuse Solar Radiation Rate per Area,hourly; !- Zone Average [W/m2]
Output:Variable,*,Surface Outside Face Beam Solar Incident Angle Cosine Value,hourly; !- Zone Average []
Output:Variable,*,Surface Outside Face Incident Sky Diffuse Ground Reflected Solar Radiation Rate per Area,hourly; !- Zone Average [W/m2]
Output:Variable,*,Surface Outside Face Incident Sky Diffuse Surface Reflected Solar Radiation Rate per Area,hourly; !- Zone Average [W/m2]
Output:Variable,*,Surface Outside Face Incident Beam To Beam Surface Reflected Solar Radiation Rate per Area,hourly; !- Zone Average [W/m2]
Output:Variable,*,Surface Outside Face Incident Beam To Diffuse Surface Reflected Solar Radiation Rate per Area,hourly; !- Zone Average [W/m2]
Output:Variable,*,Surface Outside Face Incident Beam To Diffuse Ground Reflected Solar Radiation Rate per Area,hourly; !- Zone Average [W/m2]
Output:Variable,*,Surface Anisotropic Sky Multiplier,hourly; !- Zone Average []
Output:Variable,*,Surface Window BSDF Beam Direction Number,hourly; !- Zone Average []
Output:Variable,*,Surface Window BSDF Beam Theta Angle,hourly; !- Zone Average [rad]
Output:Variable,*,Surface Window BSDF Beam Phi Angle,hourly; !- Zone Average [rad]
Output:Variable,*,Surface Window Total Glazing Layers Absorbed Solar Radiation Rate,hourly; !- Zone Average [W]
Output:Variable,*,Surface Window Total Glazing Layers Absorbed Shortwave Radiation Rate,hourly; !- Zone Average [W]
Output:Variable,*,Surface Window Total Absorbed Shortwave Radiation Rate Layer 1,hourly; !- Zone Average [W]
Output:Variable,*,Surface Window Front Face Temperature Layer 1,hourly; !- Zone Average [C]
Output:Variable,*,Surface Window Back Face Temperature Layer 1,hourly; !- Zone Average [C]
Output:Variable,*,Surface Window Transmitted Solar Radiation Rate,hourly; !- Zone Average [W]
Output:Variable,*,Surface Window Transmitted Beam Solar Radiation Rate,hourly; !- Zone Average [W]
Output:Variable,*,Surface Window Transmitted Beam To Beam Solar Radiation Rate,hourly; !- Zone Average [W]
Output:Variable,*,Surface Window Transmitted Beam To Diffuse Solar Radiation Rate,hourly; !- Zone Average [W]
Output:Variable,*,Surface Window Transmitted Diffuse Solar Radiation Rate,hourly; !- Zone Average [W]
Output:Variable,*,Surface Window Heat Gain Rate,hourly; !- Zone Average [W]
Output:Variable,*,Surface Window Heat Loss Rate,hourly; !- Zone Average [W]
Output:Variable,*,Surface Window Gap Convective Heat Transfer Rate,hourly; !- Zone Average [W]
Output:Variable,*,Surface Window Shading Device Absorbed Solar Radiation Rate,hourly; !- Zone Average [W]
Output:Variable,*,Surface Window Total Glazing Layers Absorbed Solar Radiation Energy,hourly; !- Zone Sum [J]
Output:Variable,*,Surface Window Transmitted Solar Radiation Energy,hourly; !- Zone Sum [J]
Output:Variable,*,Surface Window Transmitted Beam Solar Radiation Energy,hourly; !- Zone Sum [J]
Output:Variable,*,Surface Window Transmitted Beam To Beam Solar Radiation Energy,hourly; !- Zone Sum [J]
Output:Variable,*,Surface Window Transmitted Beam To Diffuse Solar Radiation Energy,hourly; !- Zone Sum [J]
Output:Variable,*,Surface Window Transmitted Diffuse Solar Radiation Energy,hourly; !- Zone Sum [J]
Output:Variable,*,Surface Window Heat Gain Energy,hourly; !- Zone Sum [J]
Output:Variable,*,Surface Window Heat Loss Energy,hourly; !- Zone Sum [J]
Output:Variable,*,Surface Window Gap Convective Heat Transfer Energy,hourly; !- Zone Sum [J]
Output:Variable,*,Surface Window Shading Device Absorbed Solar Radiation Energy,hourly; !- Zone Sum [J]
Output:Variable,*,Surface Window System Solar Transmittance,hourly; !- Zone Average []
Output:Variable,*,Surface Window System Solar Reflectance,hourly; !- Zone Average []
Output:Variable,*,Surface Window System Solar Absorptance,hourly; !- Zone Average []
Output:Variable,*,Surface Window Inside Face Glazing Condensation Status,hourly; !- Zone Average []
Output:Variable,*,Surface Window Inside Face Frame Condensation Status,hourly; !- Zone Average []
Output:Variable,*,Surface Window Inside Face Divider Condensation Status,hourly; !- Zone Average []
Output:Variable,*,Surface Window Outside Reveal Reflected Beam Solar Radiation Rate,hourly; !- Zone Average [W]
Output:Variable,*,Surface Window Outside Reveal Reflected Beam Solar Radiation Energy,hourly; !- Zone Sum [J]
Output:Variable,*,Surface Window Solar Horizontal Profile Angle,hourly; !- Zone Average [deg]
Output:Variable,*,Surface Window Solar Vertical Profile Angle,hourly; !- Zone Average [deg]
Output:Variable,*,Surface Window Glazing Beam to Beam Solar Transmittance,hourly; !- Zone Average []
Output:Variable,*,Surface Window Glazing Beam to Diffuse Solar Transmittance,hourly; !- Zone Average []
Output:Variable,*,Surface Window Glazing Diffuse to Diffuse Solar Transmittance,hourly; !- Zone Average []
Output:Variable,*,Surface Window Model Solver Iteration Count,hourly; !- Zone Average []
Output:Variable,*,Surface Inside Face Exterior Windows Incident Beam Solar Radiation Rate per Area,hourly; !- Zone Average [W/m2]
Output:Variable,*,Surface Inside Face Exterior Windows Incident Beam Solar Radiation Rate,hourly; !- Zone Average [W]
Output:Variable,*,Surface Inside Face Interior Windows Incident Beam Solar Radiation Rate per Area,hourly; !- Zone Average [W/m2]
Output:Variable,*,Surface Inside Face Interior Windows Incident Beam Solar Radiation Rate,hourly; !- Zone Average [W]
Output:Variable,*,Surface Inside Face Initial Transmitted Diffuse Absorbed Solar Radiation Rate,hourly; !- Zone Average [W]
Output:Variable,*,Surface Inside Face Initial Transmitted Diffuse Transmitted Out Window Solar Radiation Rate,hourly; !- Zone Average [W]
Output:Variable,*,Surface Inside Face Absorbed Shortwave Radiation Rate,hourly; !- Zone Average [W]
Output:Variable,*,Surface Inside Face Exterior Windows Incident Beam Solar Radiation Energy,hourly; !- Zone Sum [J]
Output:Variable,*,Surface Inside Face Interior Windows Incident Beam Solar Radiation Energy,hourly; !- Zone Sum [J]
Output:Variable,*,Debug Surface Solar Shading Model DifShdgRatioIsoSky,hourly; !- Zone Average []
Output:Variable,*,Debug Surface Solar Shading Model DifShdgRatioHoriz,hourly; !- Zone Average []
Output:Variable,*,Debug Surface Solar Shading Model WithShdgIsoSky,hourly; !- Zone Average []
Output:Variable,*,Debug Surface Solar Shading Model WoShdgIsoSky,hourly; !- Zone Average []
Output:Variable,*,Surface Inside Face Temperature,hourly; !- Zone Average [C]
Output:Variable,*,Surface Outside Face Temperature,hourly; !- Zone Average [C]
Output:Variable,*,Surface Inside Face Adjacent Air Temperature,hourly; !- Zone Average [C]
Output:Variable,*,Surface Inside Face Convection Heat Transfer Coefficient,hourly; !- Zone Average [W/m2-K]
Output:Variable,*,Surface Inside Face Convection Heat Gain Rate,hourly; !- Zone Average [W]
Output:Variable,*,Surface Inside Face Convection Heat Gain Rate per Area,hourly; !- Zone Average [W/m2]
Output:Variable,*,Surface Inside Face Convection Heat Gain Energy,hourly; !- Zone Sum [J]
Output:Variable,*,Surface Inside Face Net Surface Thermal Radiation Heat Gain Rate,hourly; !- Zone Average [W]
Output:Variable,*,Surface Inside Face Net Surface Thermal Radiation Heat Gain Rate per Area,hourly; !- Zone Average [W/m2]
Output:Variable,*,Surface Inside Face Net Surface Thermal Radiation Heat Gain Energy,hourly; !- Zone Sum [J]
Output:Variable,*,Surface Inside Face Solar Radiation Heat Gain Rate,hourly; !- Zone Average [W]
Output:Variable,*,Surface Inside Face Solar Radiation Heat Gain Rate per Area,hourly; !- Zone Average [W/m2]
Output:Variable,*,Surface Inside Face Solar Radiation Heat Gain Energy,hourly; !- Zone Sum [J]
Output:Variable,*,Surface Inside Face Lights Radiation Heat Gain Rate,hourly; !- Zone Average [W]
Output:Variable,*,Surface Inside Face Lights Radiation Heat Gain Rate per Area,hourly; !- Zone Average [W/m2]
Output:Variable,*,Surface Inside Face Lights Radiation Heat Gain Energy,hourly; !- Zone Sum [J]
Output:Variable,*,Surface Inside Face Internal Gains Radiation Heat Gain Rate,hourly; !- Zone Average [W]
Output:Variable,*,Surface Inside Face Internal Gains Radiation Heat Gain Rate per Area,hourly; !- Zone Average [W/m2]
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""")
# EnergyPlus
runenergysimulation = Honeybee_RunEnergySimulation(
    epwFile=path,
    analysisPeriod=analysisperiod.analysisPeriod,
    energySimPar=energysimpar,
    HBZones=flatten(setepzonethresholds),
    simulationOutputs=flatten(writeresultparameters.simulationOutputs),
    writeIdf=Toggle(False),
    runEnergyPlus=Toggle(False),
    idfFileName="010",
    meshingLevel=1)  # -> report, idfFileAddress, resultFileAddress; plug-in component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
# gbXML
grizzlybear = Honeybee_GrizzlyBear(
    EquipRange=epd,
    LPDRange=lpd,
    bldgType=bldgtype,
    rhinolocation="San Francisco 50 50 94123",
    HBZones=flatten(setepzonecnstr),
    writegbXML=Toggle(True),
    workingDir="C:\\gbXML\\",
    fileName="test")  # -> readMe, resultFileAddress; plug-in component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
panel_26 = Panel(exporttoopenstudio.resultsFileAddress)
panel_27 = Panel(exporttoopenstudio.idfFileAddress)
panel_28 = Panel(exporttoopenstudio.osmFileAddress)
panel_29 = Panel(runenergysimulation.report)
panel_30 = Panel(runenergysimulation.resultFileAddress)
panel_31 = Panel(exporttoopenstudio.ReadMe)
file = ReadFile(File=grizzlybear.resultFileAddress, PerLineParse=True)
panel_32 = Panel(grizzlybear.readMe)
panel_33 = Panel(grizzlybear.resultFileAddress)
python = PythonScript(importXML=file)  # -> out, points; inputs importXML: list
# ---------- python: Python ----------
import Rhino as rc
points = []
pointCount = 0 
lineToBePassed =[]
for lineCount, line in enumerate(importXML):
    line = line.strip()
    if not lineCount in lineToBePassed:
        if line.startswith("<Cart"):
            pointCount += 1
            pointCoor = []
            for count in range(1,4):
                pointCoor.append(float(importXML[lineCount + count].split(">")[1].split("<")[0]))
                lineToBePassed.append(lineCount + count)
            points.append(rc.Geometry.Point3d(*pointCoor))

print pointCount
# ---------- end python ----------
readidf = Honeybee_ReadEPResult()  # -> report, port, simplify(zoneHeating), zoneCooling, zoneElectricLight, zoneElectricEquip, port_2, zonePeopleGains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; plug-in component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
preview_3 = CustomPreview(
    Geometry=python.points,
    Shader={ambient=RGB(0, 0, 0), diffuse=RGB(255, 105, 180), emission=RGB(76, 32, 54), shine=0.5, specular=RGB(255, 255, 255), transparency=0})
graph = QuickGraph(readidf.zoneCooling)

division = Division()
subtraction = Subtraction()
division_2 = Division(A=subtraction)

addition = Addition(B=division)
end = EndPoints()  # -> Start, End
toggle_5 = BooleanToggle(True)
pline = PolyLine(Vertices=[end.Start, end.End], Closed=toggle_5)
vec = VectorXYZ(XComponent=0, YComponent=0, ZComponent=Slider(4, range=0..5))  # -> Vector, Length
devec = DeconstructVector(Vector=vec.Vector)  # -> XComponent, YComponent, ZComponent
addition_2 = Addition(A=devec.YComponent, B=Slider(2, range=-100..100))
vec_2 = VectorXYZ(XComponent=devec.XComponent, YComponent=addition_2, ZComponent=devec.ZComponent)  # -> Vector, Length

scale = Scale(Center=addition, Factor=division_2)  # -> Geometry, Transform

end_2 = EndPoints(Curve=scale.Geometry)  # -> Start, End
pdecon = Deconstruct(Point=end_2.End)  # -> XComponent, YComponent, ZComponent
pdecon_2 = Deconstruct(Point=end_2.Start)  # -> XComponent, YComponent, ZComponent
python_2 = PythonScript(
    x1=pdecon_2.XComponent,
    y1=pdecon_2.YComponent,
    z1=pdecon_2.ZComponent,
    x2=pdecon.XComponent,
    y2=pdecon.YComponent,
    z2=pdecon.ZComponent)  # -> out, crossu, crossvec
# ---------- python_2: Python ----------
import math
import rhinoscriptsyntax as rs
import Rhino as rc
import scriptcontext as sc
from clr import AddReference
AddReference('Grasshopper')
import Grasshopper.Kernel as gh

print x1,y1,z1,x2,y2,z2

lvecx = x2-x1
lvecy = y2-y1
lvecz = z2-z1
lvec = [lvecx,lvecy,lvecz]
zvec = [0,0,1]

print lvec

crossx = zvec[1]*lvec[2] - zvec[2]*lvec[1]
crossy = zvec[2]*lvec[0] - zvec[0]*lvec[2]
crossz = zvec[0]*lvec[1] - zvec[1]*lvec[0]

cross = [crossx,crossy,crossz]
print cross
mag = math.sqrt(math.pow(crossx,2) + math.pow(crossy,2) + math.pow(crossz,2))
print mag

crossu = [c/mag for c in cross]

print crossu

xvec = [1,0,0]
dotx = crossu[0]*xvec[0]
doty = crossu[1]*xvec[1]
dotz = crossu[2]*xvec[2]

dot = dotx+doty+dotz
rad = math.acos(dot)
deg = rad*180/math.pi
rel = 1/math.cos(rad)

crossvec = rc.Geometry.Vector3d(rel,0,0)
# ---------- end python_2 ----------
multiplication = Multiplication(A=python_2.crossvec)
move = Move(Geometry=scale.Geometry, Motion=multiplication)  # -> Geometry, Transform
end_3 = EndPoints(Curve=move.Geometry)  # -> Start, End
pline_2 = PolyLine(Vertices=[end_3.Start, end_3.End, end.End, end.Start], Closed=toggle_5)
pline_3 = PolyLine(Vertices=[end_3.Start, end.Start], Closed=toggle_5)
pline_4 = PolyLine(Vertices=[end_3.End, end.End], Closed=toggle_5)
pline_5 = PolyLine(Vertices=[end_3.End, end_3.Start], Closed=toggle_5)
extr_3 = Extrude(Base=[pline_2, pline_3, pline, pline_4, pline_5], Direction=vec.Vector)
cap = CapHoles(Brep=extr_3)
rotate = Rotate(Geometry=cap, Center=Point(0, 0, 0), From=Vector(1, 0, 0), To=Vector(0, 1, 0))  # -> Geometry, Transform
mirror = Mirror(Geometry=cap, Plane=PlaneYZ(0, 0, 0))  # -> Geometry, Transform
geo = Geometry([cap, mirror.Geometry])
move_2 = Move(Geometry=geo, Motion=vec_2.Vector)  # -> Geometry, Transform
rotate_2 = Rotate(Geometry=move_2.Geometry, Center=Point(0, 0, 0), From=Vector(1, 0, 0), To=Vector(0, 1, 0))  # -> Geometry, Transform

simplebuildingdriver = PythonScript()  # -> createThermalZones, writegbXML, writeIDFBool, runEPlusBool, X, Y, Offset, spaceHeight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
# ---------- simplebuildingdriver: Python ----------
createThermalZones = False
writegbXML = False
writeIDFBool = False
runEPlusBool = False

xmin = 10
xmax = 20
xstep = 5
xtotal = (xmax-xmin)/xstep+1
ymin = 10
ymax = 20
ystep = 5
ytotal = (ymax-ymin)/ystep+1
offsetmin = 3
offsetmax = 7
offsetstep = 2
offsettotal = (offsetmax-offsetmin)/offsetstep+1
spaceheight = 4
numfloorsmin = 1
numfloorsmax = 3
numfloorsstep = 1
numfloorstotal = (numfloorsmax-numfloorsmin)/numfloorsstep+1
WWRmin = 10
WWRmax = 30
WWRstep = 10
WWRtotal = (WWRmax-WWRmin)/WWRstep+1
totalsims = int(xtotal*ytotal*offsettotal*numfloorstotal*WWRtotal)
print totalsims
folderroot = "C:\\ladybug\\"


X=xmin
Y=ymin
Offset = offsetmin
spaceHeight = spaceheight
numfloors = numfloorsmin
WWR = WWRmin
runName = 1
folderPath = folderroot+"\\"+str(runName)
writeIDFBool = True
runEPlusBool = True
writegbxml = True

result = []
for X in range(xmin,xmax+xstep,xstep):

    for Y in range(ymin,ymax+ystep,ystep):
        
        for Offset in range(offsetmin,offsetmax+offsetstep,offsetstep):
            
            for numFloors in range(numfloorsmin,numfloorsmax+numfloorsstep,numfloorsstep):
                
                for wwr in range(WWRmin,WWRmax+WWRstep,WWRstep):
                    WWR = wwr/100
                    WWR = int(WWR*100) / 100.0
                    row = []
                    row.append(X)
                    row.append(Y)
                    row.append(Offset)
                    row.append(spaceHeight)
                    row.append(numFloors)
                    row.append(WWR)
                    result.append(row)
                    createThermalZones = True
                    writegbXML = True
                    writeIDFBool = True
                    runEPlusBool = True
                    #wait for the result?
                    
                    
constructionStuff = result
print len(result)
for res in result:
    print res
# ---------- end simplebuildingdriver ----------
x_slider = Slider(45, range=45..100)
floor_height = Slider(5, range=0..10)
y_slider = Slider(45, range=45..100)
rectangle = Rectangle(Plane=PlaneXY(0, 0, 0), XSize=x_slider, YSize=y_slider, Radius=0)  # -> Rectangle, Length
disc = Discontinuity(Curve=rectangle.Rectangle, Level=1)  # -> Points, Parameters
Z_3 = UnitZ(Factor=floor_height)
numberoffloors = Slider(2, range=0..10)
series = Series(Start=0, Step=Z_3, Count=numberoffloors)

division_3 = Division(A=x_slider, B=Slider(4, range=0..10))
division_4 = Division(A=y_slider, B=Slider(5, range=0..10))
multiplication_2 = Multiplication(A=floor_height, B="1.5")

neg = Negative(Value=multiplication_2)
offset = Offset(Curve=rectangle.Rectangle, Distance=neg, Plane=PlaneXY(0, 0, 0), Corners=1)
disc_2 = Discontinuity(Curve=offset, Level=1)  # -> Points, Parameters
explode = Explode(Curve=offset, Recursive=True)  # -> Segments, Vertices
ln = Line(StartPoint=disc.Points, EndPoint=disc_2.Points)

item_4 = ListItem(List=explode.Vertices, Index="1", Wrap=True)
item_5 = ListItem(List=explode.Vertices, Index="0", Wrap=True)
item_6 = ListItem(List=explode.Vertices, Index="2", Wrap=True)
item_7 = ListItem(List=explode.Vertices, Index="3", Wrap=True)

# ---- group: Core
pdecon_3 = Deconstruct(Point=item_7)  # -> XComponent, YComponent, ZComponent
addition_3 = Addition(A=pdecon_3.XComponent, B=division_3)
pt = ConstructPoint(XCoordinate=addition_3, YCoordinate=0, ZCoordinate=pdecon_3.ZComponent)

pdecon_4 = Deconstruct(Point=item_5)  # -> XComponent, YComponent, ZComponent
addition_4 = Addition(A=pdecon_4.YComponent, B=division_4)
addition_5 = Addition(A=pdecon_4.XComponent, B=division_3)
pt_2 = ConstructPoint(XCoordinate=addition_5, YCoordinate=addition_4, ZCoordinate=pdecon_4.ZComponent)

pdecon_5 = Deconstruct(Point=item_4)  # -> XComponent, YComponent, ZComponent
multiplication_3 = Multiplication(A=division_3, B="-1")
addition_6 = Addition(A=pdecon_5.XComponent, B=multiplication_3)
pt_3 = ConstructPoint(XCoordinate=addition_6, YCoordinate=addition_4, ZCoordinate=pdecon_5.ZComponent)

# ---- group: South
item_8 = ListItem(List=ln, Index="0", Wrap=True)
item_9 = ListItem(List=ln, Index="1", Wrap=True)
end_4 = EndPoints(Curve=item_8)  # -> Start, End
end_5 = EndPoints(Curve=item_9)  # -> Start, End
pline_6 = PolyLine(Vertices=[end_4.Start, end_4.End, end_5.End, end_5.Start], Closed=True)

# ---- group: East
item_10 = ListItem(List=ln, Index="1", Wrap=True)
item_11 = ListItem(List=ln, Index="2", Wrap=True)
end_6 = EndPoints(Curve=item_10)  # -> Start, End
end_7 = EndPoints(Curve=item_11)  # -> Start, End
pline_7 = PolyLine(Vertices=[end_6.Start, end_7.Start, end_7.End, end_6.End], Closed=True)

# ---- group: West
item_12 = ListItem(List=ln, Index="3", Wrap=True)
item_13 = ListItem(List=ln, Index="0", Wrap=True)
end_8 = EndPoints(Curve=item_12)  # -> Start, End
end_9 = EndPoints(Curve=item_13)  # -> Start, End
pline_8 = PolyLine(Vertices=[end_8.Start, end_9.Start, end_9.End, end_8.End], Closed=True)

# ---- group: East
item_14 = ListItem(List=ln, Index="2", Wrap=True)
item_15 = ListItem(List=ln, Index="3", Wrap=True)
end_10 = EndPoints(Curve=item_14)  # -> Start, End
end_11 = EndPoints(Curve=item_15)  # -> Start, End
pline_9 = PolyLine(Vertices=[end_10.Start, end_11.Start, end_11.End, end_10.End], Closed=True)

# ----
pline_10 = PolyLine(Vertices=[item_5, item_4, pt_3, pt_2], Closed=toggle)
pline_11 = PolyLine(Vertices=[item_5, pt_2, pt, item_7], Closed=toggle)
pline_12 = PolyLine(Vertices=[item_7, pt, item_6], Closed=toggle)
pline_13 = PolyLine(Vertices=[item_4, item_6, pt_3], Closed=toggle)
pline_14 = PolyLine(Vertices=[pt_2, pt_3, pt], Closed=toggle)
extr_4 = Extrude(Base=[pline_12, pline_11, pline_13, pline_10], Direction=Z_3)

# ---- group: All Extrusions
extr_5 = Extrude(Base=[pline_7, pline_6, pline_9, pline_8, pline_14], Direction=Z_3)
cap_2 = CapHoles(Brep=extr_5)

# ----
cap_3 = CapHoles(Brep=extr_4)

item_16 = ListItem(List=cap_2, Index="0", Wrap=True)
item_17 = ListItem(List=cap_2, Index="3", Wrap=True)
item_18 = ListItem(List=cap_2, Index="4", Wrap=True)
item_19 = ListItem(List=cap_2, Index="1", Wrap=True)
item_20 = ListItem(List=cap_2, Index="2", Wrap=True)
Z_4 = UnitZ(Factor=series)
move_3 = Move(Geometry=item_16, Motion=Z_4)  # -> Geometry, Transform
move_4 = Move(Geometry=item_19, Motion=Z_4)  # -> Geometry, Transform
move_5 = Move(Geometry=item_20, Motion=Z_4)  # -> Geometry, Transform
move_6 = Move(Geometry=item_17, Motion=Z_4)  # -> Geometry, Transform
move_7 = Move(Geometry=item_18, Motion=Z_4)  # -> Geometry, Transform
geo_2 = Geometry([move_3.Geometry, move_4.Geometry, move_5.Geometry, move_6.Geometry, move_7.Geometry, cap_3])
